# Grasshopper definition MPDA_HNP_Final.gh (Grasshopper 1.0.8)

read_file = ReadFile(File="C:\MPDA\Session03\MPDA_HNP\MPDA_surface.py", PerLineParse=False)
pt = ConstructPoint(XCoordinate=Slider(130, range=0..200), YCoordinate=Slider(76, range=0..200), ZCoordinate=0)
python_3_script = Python3Script(
    script=read_file,
    amp_h=Slider(11, range=0..20),
    amp_v=Slider(1, range=0..10),
    freq_h=Slider(3, range=0..10),
    freq_v=Slider(1, range=0..10),
    div_u=Slider(15, range=0..50),
    div_v=Slider(15, range=0..50),
    width=Slider(200, range=0..200),
    length=Slider(200, range=0..200),
    height=Slider(20, range=0..50),
    drop_height=Slider(116, range=0..200),
    drop_part_ratio=Slider(0.4, range=0..1),
    drop_location=pt)  # -> mesh, points, strips_u, strips_v; inputs drop_height: Int32, drop_location: Point3d; unedited script template
pt_2 = Point(python_3_script.points)
mesh = Mesh(python_3_script.mesh)
crv = Curve(python_3_script.strips_u)
crv_2 = Curve(python_3_script.strips_v)
read_file_2 = ReadFile(File="C:\MPDA\Session03\MPDA_HNP\MPDA_Waffel.py", PerLineParse=False)
python_3_script_2 = Python3Script(
    script_A=read_file_2,
    mesh=mesh,
    strips_u=crv,
    strips_v=crv_2,
    rib_width=Slider(0.73, range=0..2),
    rib_height=Slider(4.15, range=2..5))  # -> frames_mesh, frames_curve, mesh; inputs mesh: Mesh, strips_u: Curve, strips_v: Curve, rib_width: Int32, rib_height: Int32; unedited script template
mesh_2 = Mesh(python_3_script_2.frames_mesh)
crv_3 = Curve(python_3_script_2.frames_curve)
mesh_3 = Mesh(python_3_script_2.mesh)
preview = CustomPreview(Geometry=mesh_3, Material=ColourSwatch(SwatchColor=RGBA(104, 196, 81, 176)))
panel = Panel(mesh_2)
panel_2 = Panel(mesh_3)
panel_3 = Panel(crv_3)
